# Dynamo graph FloorReinforcement.dyn (Dynamo 2.12.1.8246)
# packages: Structural Design 2022.4.17

select_model_elements_by = DSModelElementsByCategorySelection("3a729faa-ecf4-4dab-8c95-f59198a5d442-000517aa,3a729faa-ecf4-4dab-8c95-f59198a5d442-000517e4")  # "Select Model Elements By Category"; 2 picked in the model; graph input
geometry = Element.Geometry(element=select_model_elements_by)
faces = Topology.Faces(topology=geometry)
surfaceGeometry = Face.SurfaceGeometry(face=faces)
perimeterCurves = Surface.PerimeterCurves(surface=surfaceGeometry@L1)
flatten = List.Flatten(list=perimeterCurves)
code_block = CodeBlock(Garis=flatten) { Garis[0]; }
direction = Line.Direction(line=code_block)
boolean = BoolSelector(true)
rebarBarType = RevitRebarBarType("D10")  # graph input
code_block_2 = CodeBlock { 150; }
code_block_3 = CodeBlock { 150; }
createBasedOnHost = StructuralDesign.Rebar.AreaReinforcement.AreaReinforcement.CreateBasedOnHost(hostElement=select_model_elements_by, majorDirection=direction, layoutRule=boolean, topMajorBarType=rebarBarType, topMajorSpacing=code_block_2, topMinorBarType=rebarBarType, topMinorSpacing=code_block_2, bottomMajorBarType=rebarBarType, bottomMajorSpacing=code_block_3, bottomMinorBarType=rebarBarType, bottomMinorSpacing=code_block_3)
rebarHookType = RevitRebarHookType("Rebar Hook 90")  # graph input
boolean_2 = BoolSelector(true)
setHooks = StructuralDesign.Rebar.AreaReinforcement.AreaReinforcement.SetHooks(areaReinforcement=createBasedOnHost, topMajorHookType=rebarHookType, topMinorHookType=rebarHookType, bottomMajorHookType=rebarHookType, bottomMinorHookType=rebarHookType, bottomMinorHookOrientation=boolean_2)
views = Views("{3D}")  # graph input
setSolidInView = StructuralDesign.Rebar.AreaReinforcement.AreaReinforcement.SetSolidInView(areaReinforcement=setHooks, view=views)
boolean_3 = BoolSelector(true)
setUnobscuredInView = StructuralDesign.Rebar.AreaReinforcement.AreaReinforcement.SetUnobscuredInView(areaReinforcement=setHooks, view=views, unobscured=boolean_3)
