# Dynamo graph R2022_CeilingCreation.dyn "2022_CeilingCreation" (Dynamo 2.12.1.8246)

select_faces = SelectFaces()  # 5 picked in the model; graph input
perimeterCurves = Surface.PerimeterCurves(surface=select_faces)
ceiling_types = CeilingTypes("600x600mm_Grid")  # graph input
levels = Levels("Lantai 1")  # graph input
byOutlineTypeAndLevel = Ceiling.ByOutlineTypeAndLevel(outline=perimeterCurves, ceilingType=ceiling_types, level=levels)
