# Dynamo graph R2022_FloorCreation.dyn (Dynamo 2.12.1.8246)

select_model_elements = DSModelElementsSelection()  # 5 picked in the model; graph input
geometry = Element.Geometry(element=select_model_elements)
faces = Topology.Faces(topology=geometry)
surfaceGeometry = Face.SurfaceGeometry(face=faces)
normalAtParameter = Surface.NormalAtParameter(surface=surfaceGeometry)
code_block = CodeBlock { 0; -1; }
byCoordinates = Vector.ByCoordinates(x=code_block.out0, y=code_block.out0, z=code_block.out1)
code_block_2 = CodeBlock(V1=normalAtParameter, V2=byCoordinates) { V1.X==V2.X && V1.Y==V2.Y && V1.Z==V2.Z ? true : false; }
filterByBoolMask = List.FilterByBoolMask(list=surfaceGeometry, mask=code_block_2)
flatten = List.Flatten(list=filterByBoolMask.in)
perimeterCurves = Surface.PerimeterCurves(surface=flatten)
floor_types = FloorTypes("Floor_Timber_22Cbd-225Joist")  # graph input
levels = Levels("Lantai 1")  # graph input
byOutlineTypeAndLevel = Floor.ByOutlineTypeAndLevel(outline=perimeterCurves, floorType=floor_types, level=levels)
