# Dynamo graph R2022_FoundationNumbering.dyn (Dynamo 2.12.1.8246)

select_model_elements = DSModelElementsSelection()  # 64 picked in the model; graph input
name = Element.Name(element=select_model_elements)
family_types = FamilyTypes("Footing-Rectangular:P1")  # graph input
name_2 = Family.Name(family=family_types)
eq = name == name_2
filterByBoolMask = List.FilterByBoolMask(list=select_model_elements, mask=eq)
code_block = CodeBlock { "Mark"; }
code_block_2 = CodeBlock(X=filterByBoolMask.in) { X + "-"; }
count = List.Count(list=filterByBoolMask.in)
code_block_3 = CodeBlock(x=count) { 1..x; }
add = code_block_2 + code_block_3
setParameterByName = Element.SetParameterByName(element=filterByBoolMask.in, parameterName=code_block, value=add)
