# Dynamo graph R2022_JoinGeometry.dyn "JoinGeometry" (Dynamo 2.12.1.8246)

select_model_elements_by = DSModelElementsByCategorySelection("6946a2f0-50c4-434a-a911-18bcb1d75325-0004dffd,6946a2f0-50c4-434a-a911-18bcb1d75325-0004dfff,6946a2f0-50c4-434a-a911-18bcb1d75325-0004e000,6946a2f0-50c4-434a-a911-18bcb1d75325-0004e063,6946a2f0-50c4-434a-a911-18bcb1d75325-0004e064,6946a2f0-50c4-434a-a911-18bcb1d75325-0004e065,6946a2f0-50c4-434a-a911-18bcb1d75325-0004e09d,6946a2f0-50c4-434a-a911-18bcb1d75325-0004e09e,6946a2f0-50c4-434a-a911-18bcb1d75325-0004e09f,6946a2f0-50c4-434a-a911-18bcb1d75325-0004e0a4,6946a2f0-50c4-434a-a911-18bcb1d75325-0004e0a5,6946a2f0-50c4-434a-a911-18bcb1d75325-0004e0a9,6946a2f0-50c4-434a-a911-18bcb1d75325-0004e0aa,6946a2f0-50c4-434a-a911-18bcb1d75325-0004e0ab,6946a2f0-50c4-434a-a911-18bcb1d75325-0004e0af,6946a2f0-50c4-434a-a911-18bcb1d75325-0004e0b0,6946a2f0-50c4-434a-a911-18bcb1d75325-0004e0b1,6946a2f0-50c4-434a-a911-18bcb1d75325-0004e0b5,6946a2f0-50c4-434a-a911-18bcb1d75325-0004e0b6,6946a2f0-50c4-434a-a911-18bcb1d75325-0004e0b7,6946a2f0-50c4-434a-a911-18bcb1d75325-0004e0ef,6946a2f0-50c4-434a-a911-18bcb1d75325-0004e0f0,6946a2f0-50c4-434a-a911-18bcb1d75325-0004e0f1,6946a2f0-50c4-434a-a911-18bcb1d75325-0004e0f2,6946a2f0-50c4-434a-a911-18bcb1d75325-0004e0f3,6946a2f0-50c4-434a-a911-18bcb1d75325-0004e0f4,6946a2f0-50c4-434a-a911-18bcb1d75325-0004e0f5,6946a2f0-50c4-434a-a911-18bcb1d75325-0004e0f6,6946a2f0-50c4-434a-a911-18bcb1d75325-0004e0f7,6946a2f0-50c4-434a-a911-18bcb1d75325-0004e0f8,6946a2f0-50c4-434a-a911-18bcb1d75325-0004e0f9,6946a2f0-50c4-434a-a911-18bcb1d75325-0004e0fb,6946a2f0-50c4-434a-a911-18bcb1d75325-0004e0fc,6946a2f0-50c4-434a-a911-18bcb1d75325-0004e0fd,6946a2f0-50c4-434a-a911-18bcb1d75325-0004e0fe,6946a2f0-50c4-434a-a911-18bcb1d75325-0004e0ff,6946a2f0-50c4-434a-a911-18bcb1d75325-0004e100,6946a2f0-50c4-434a-a911-18bcb1d75325-0004e101,6946a2f0-50c4-434a-a911-18bcb1d75325-0004e102,6946a2f0-50c4-434a-a911-18bcb1d75325-0004e103,50863391-349b-4945-bf3e-e14cdc29c4e5-000567af,50863391-349b-4945-bf3e-e14cdc29c4e5-0005687c,50863391-349b-4945-bf3e-e14cdc29c4e5-00056920,50863391-349b-4945-bf3e-e14cdc29c4e5-0005697d")  # "Select Model Elements By Category"; 44 picked in the model; graph input
select_model_elements_by_2 = DSModelElementsByCategorySelection("6946a2f0-50c4-434a-a911-18bcb1d75325-00052911,6946a2f0-50c4-434a-a911-18bcb1d75325-00052912,6946a2f0-50c4-434a-a911-18bcb1d75325-00052913,6946a2f0-50c4-434a-a911-18bcb1d75325-00052914,6946a2f0-50c4-434a-a911-18bcb1d75325-00052915,6946a2f0-50c4-434a-a911-18bcb1d75325-00052916,6946a2f0-50c4-434a-a911-18bcb1d75325-00052917,6946a2f0-50c4-434a-a911-18bcb1d75325-00052918,6946a2f0-50c4-434a-a911-18bcb1d75325-00052919,6946a2f0-50c4-434a-a911-18bcb1d75325-0005291a,6946a2f0-50c4-434a-a911-18bcb1d75325-0005291b,6946a2f0-50c4-434a-a911-18bcb1d75325-0005291c,6946a2f0-50c4-434a-a911-18bcb1d75325-0005291d,6946a2f0-50c4-434a-a911-18bcb1d75325-0005291e,6946a2f0-50c4-434a-a911-18bcb1d75325-0005291f,6946a2f0-50c4-434a-a911-18bcb1d75325-00052920,6946a2f0-50c4-434a-a911-18bcb1d75325-00052921,6946a2f0-50c4-434a-a911-18bcb1d75325-00052922,6946a2f0-50c4-434a-a911-18bcb1d75325-00052923,6946a2f0-50c4-434a-a911-18bcb1d75325-00052924,6946a2f0-50c4-434a-a911-18bcb1d75325-00052925,6946a2f0-50c4-434a-a911-18bcb1d75325-00052926,6946a2f0-50c4-434a-a911-18bcb1d75325-00052927,6946a2f0-50c4-434a-a911-18bcb1d75325-00052928,6946a2f0-50c4-434a-a911-18bcb1d75325-00052929,6946a2f0-50c4-434a-a911-18bcb1d75325-0005292a,6946a2f0-50c4-434a-a911-18bcb1d75325-0005292b,6946a2f0-50c4-434a-a911-18bcb1d75325-0005292c,6946a2f0-50c4-434a-a911-18bcb1d75325-0005292d,6946a2f0-50c4-434a-a911-18bcb1d75325-0005292e,6946a2f0-50c4-434a-a911-18bcb1d75325-0005292f,6946a2f0-50c4-434a-a911-18bcb1d75325-00052930,6946a2f0-50c4-434a-a911-18bcb1d75325-00052931,6946a2f0-50c4-434a-a911-18bcb1d75325-00052932,6946a2f0-50c4-434a-a911-18bcb1d75325-00052933,6946a2f0-50c4-434a-a911-18bcb1d75325-00052934,6946a2f0-50c4-434a-a911-18bcb1d75325-00052935,6946a2f0-50c4-434a-a911-18bcb1d75325-00052936,6946a2f0-50c4-434a-a911-18bcb1d75325-00052937,6946a2f0-50c4-434a-a911-18bcb1d75325-00052938")  # "Select Model Elements By Category"; 40 picked in the model; graph input
joinGeometry = Element.JoinGeometry(element=select_model_elements_by, otherElement=select_model_elements_by_2)
