# Dynamo graph R2022_RoomDeletion.dyn (Dynamo 2.12.1.8246)

categories = Categories("OST_Rooms")
all_elements_of_category = ElementsOfCategory(Category=categories)
area = Room.Area(room=all_elements_of_category)
code_block = CodeBlock(area=area) { area != 0; }
filterByBoolMask = List.FilterByBoolMask(list=all_elements_of_category, mask=code_block)
delete = Element.Delete(element=filterByBoolMask.out)
