# Dynamo graph WallReinforcement.dyn (Dynamo 2.12.1.8246)
# packages: Structural Design 2022.4.17

select_model_element = DSModelElementSelection()  # 1 picked in the model; graph input
select_edge = DSEdgeSelection()  # 1 picked in the model; graph input
direction = Line.Direction(line=select_edge)
maximum_spacing = BoolSelector(true)
rebarBarType = RevitRebarBarType()  # nothing selected; graph input
spacing = CodeBlock { 200; }
createBasedOnHost = StructuralDesign.Rebar.AreaReinforcement.AreaReinforcement.CreateBasedOnHost(hostElement=select_model_element, majorDirection=direction, layoutRule=maximum_spacing, topMajorBarType=rebarBarType, topMajorSpacing=spacing, topMinorBarType=rebarBarType, topMinorSpacing=spacing, bottomMajorBarType=rebarBarType, bottomMajorSpacing=spacing, bottomMinorBarType=rebarBarType, bottomMinorSpacing=spacing)
rebarHookType = RevitRebarHookType("Rebar Hook 90")  # graph input
boolean = BoolSelector(true)
setHooks = StructuralDesign.Rebar.AreaReinforcement.AreaReinforcement.SetHooks(areaReinforcement=createBasedOnHost, bottomMinorHookType=rebarHookType, bottomMinorHookOrientation=boolean)
views = Views("{3D}")  # graph input
setSolidInView = StructuralDesign.Rebar.AreaReinforcement.AreaReinforcement.SetSolidInView(areaReinforcement=setHooks, view=views)
boolean_2 = BoolSelector(true)
setUnobscuredInView = StructuralDesign.Rebar.AreaReinforcement.AreaReinforcement.SetUnobscuredInView(areaReinforcement=setHooks, view=views, unobscured=boolean_2)
